# Dynamo graph test 03.dyn (Dynamo 2.3.0.5885)
# packages: Data-Shapes 2022.2.100, Rhythm 2017.1.8

string = StringInput("test")
textbox_data = Custom[TextBox Data](InputName=string)  # package Data-Shapes; Create Data for TextBox input in UI.MultipleInputForm ++ . Check out www.data-shapes.net for more informations
code_block = CodeBlock { "Category Selection"; }
categories_list = Custom[Categories list]()  # package Data-Shapes; Gives list of all Revit categories and a matching list of their names
dropdown_data = Custom[DropDown Data](InputName=code_block, Keys=categories_list.Category_name_s, Values=categories_list.Revit_Categories)  # package Data-Shapes; Create data for DropDown input in UI.MultiInputForm ++ . Check out www.data-shapes.net for more infos.
listview_data = Custom[Listview Data](Keys=categories_list.Category_name_s, Values=categories_list.Revit_Categories)  # package Data-Shapes; Create data for ListView input in UI.MultiInputForm ++ . Check out www.data-shapes.net for more infos.
listview_data_2 = Custom[Listview Data](Keys=categories_list.Category_name_s, Values=categories_list.Revit_Categories)
list_create = List.Create(item0=dropdown_data, item1=listview_data, item2=listview_data_2)
boolean = BoolSelector(true)
multipleinputform = Custom[MultipleInputForm ++](Inputs=list_create, Toggle=boolean)  # package Data-Shapes; Create a form with multiple inputs. see www.data-shapes.net for tutorials and infos!
flatten = List.Flatten(list=multipleinputform.User_Inputs)
string_from_object = FromObject(obj=flatten)
userMessage = Custom[UI.UserMessage](userMessage=string_from_object)  # package Rhythm; This will display a user message once. Until it is either toggled or changed.
