# Dynamo graph test 04.dyn (Dynamo 2.3.0.5885)
# packages: Data-Shapes 2021.2.91, Rhythm 2020.1.23

code_block = CodeBlock { "selected"; }
code_block_2 = CodeBlock { "Selecct Category"; }
categories_list = Custom[Categories list]()  # package Data-Shapes; Gives list of all Revit categories and a matching list of their names
listview_data = Custom[Listview Data](InputName=code_block_2, Keys=categories_list.Category_name_s, Values=categories_list.Revit_Categories)  # package Data-Shapes; Create data for ListView input in UI.MultiInputForm ++ . Check out www.data-shapes.net for more infos.
boolean = BoolSelector(true)
multipleinputform = Custom[MultipleInputForm ++](Inputs=listview_data, Toggle=boolean)  # package Data-Shapes; Create a form with multiple inputs. see www.data-shapes.net for tutorials and infos!
flatten = List.Flatten(list=multipleinputform.User_Inputs)
string_from_object = FromObject(obj=flatten)
ʳʰʸᵗʰᵐ_helpers_simpleusermessage = Rhythm.Revit.Helpers.Helpers.SimpleUserMessage(caption=code_block, message=string_from_object)
