# Dynamo graph PLM_script.dyn "Pin Linked Models" (Dynamo 2.6.1.8786)
# packages: archi-lab.net 2022.212.2922, Data-Shapes 2022.2.100, Orchid 206.3.0.8046

string = StringInput("Pin Linked Models")
file_path = Filename("C:\Users\zmelhem\Desktop\icon.jpg")
string_2 = StringInput("Pin Selected")
string_3 = StringInput("Linked Models Names")
getDocuments = archilab.Revit.Selection.Select.GetDocuments()
boolean = BoolSelector(true)
listview_data = Custom[Listview Data](InputName=string_3, Keys=getDocuments.Link_Name, Values=getDocuments.Link_Instance, ShowElementCount_optionnal=boolean, ShowId_optionnal=boolean)  # package Data-Shapes; Create data for ListView input in UI.MultiInputForm ++ . Check out www.data-shapes.net for more infos.
boolean_2 = BoolSelector(true)
multipleinputform = Custom[MultipleInputForm ++](Description_optional=string, Logo_optional=file_path, ButtonText_optional=string_2, Inputs=listview_data, Toggle=boolean_2)  # package Data-Shapes; Create a form with multiple inputs. see www.data-shapes.net for tutorials and infos!
o_element_pin = Orchid.RevitProject.Elements.Element.Pin(element=multipleinputform.User_Inputs)
