# Dynamo graph test 02.dyn "test 01" (Dynamo 2.3.0.5885)
# packages: archi-lab.net 2016.12.7

all_elements_in_active_view = ElementsInView()
current = Document.Current()
activeView = Document.ActiveView(document=current)
boolean = BoolSelector(true)
hideElements = Custom[View.HideElements](Element=all_elements_in_active_view, View=activeView, RunIt=boolean)  # package archi-lab.net; This node will hide elements in specified view.
categories = Categories("OST_Walls")
